% Simulink data dictionary uavRoadCrackDetection.sldd

LidarData = Simulink.Bus()
  pointCloud: single[32 1083 3]
  location: single[1 3]
  orientation: single[1 3]

uavGuidanceControlBus = Simulink.Bus()
  Roll: single
  Pitch: single
  YawRate: single
  Thrust: single

uavGuidanceEnvironmentBus = Simulink.Bus()
  Gravity: single, Unit="m/s^2"

uavGuidanceStateBus = Simulink.Bus()
  WorldPosition: single[3 1], Unit="m"
  WorldVelocity: single[3 1], Unit="m/s"
  EulerZYX: single[3 1], Unit="rad"
  BodyAngularRateRPY: single[3 1], Unit="rad/s"
  Thrust: single

innerLoopCmdsBus = Simulink.Bus()
  LAP: single[3]
  HeadingCmd: single
  YawCmd: single

uavPathManagerBus = Simulink.Bus()
  mode: uint8
  position: single[3 1]
  params: single[4 1]

lidarAngles = single([-3.14159274; -3.13578558; -3.12997866; -3.12417173; -3.11836457; -3.11255765; -3.10675049; -3.10094357; -3.09513664; -3.08932948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 3.14159274])
UAVSampleTime = 0.005

attitudeBus = Simulink.Bus()
  time_boot_ms: uint32, Unit="ms"
  roll: single, Unit="rad"
  pitch: single, Unit="rad"
  yaw: single, Unit="rad"
  rollspeed_p: single, Unit="rad/s"
  pitchspeed_q: single, Unit="rad/s"
  yawspeed_r: single, Unit="rad/s"

local_position_ned = Simulink.Bus()
  time_boot_ms: uint32, Unit="ms"
  x: single, Unit="m"
  y: single, Unit="m"
  z: single, Unit="m"
  vx: single, Unit="m/s"
  vy: single, Unit="m/s"
  vz: single, Unit="m/s"

uavStateBus = Simulink.Bus()
  pos_vel: Bus: local_position_ned
  attitude: Bus: attitudeBus
  gps: Bus: gps_raw_int

gps_raw_int = Simulink.Bus()  % Generic structure to hold a GPS reading
  time_usec: uint32, Unit="usec"
  fix_type: uint8
  lat: int32
  lon: int32
  alt: int32, Unit="mm"
  eph: uint16
  epv: uint16
  vel: uint16, Unit="cm/s"
  cog: uint16

gsCommandsBus = Simulink.Bus()
  RTB: uint8
  guidanceMode: uint8
  heartbeat: uint8
  newMission: uint8

waypoint = Simulink.Bus()
  wpPos: single[3]
  wpType: uint16
  wpParams: single[4]

AtmosphereBus = Simulink.Bus()
  air_temp: double, Unit="K"
  speed_sound: double
  pressure: double
  air_density: double

Controller = struct(
  Ts2Q=[1 1 1 1; 0.002413742 -0.002413742 0.002413742 -0.002413742; -0.04412346 -0.04412346 0.04412346 0.04412346; -0.04412346 0.04412346 0.04412346 -0.04412346],
  Q2Ts=[0.25 103.5736 -5.66592 -5.66592; 0.25 -103.5736 -5.66592 5.66592; 0.25 103.5736 5.66592 5.66592; 0.25 -103.5736 5.66592 -5.66592],
  takeoffGain=0.45,
  totalThrustMaxRelative=0.92,
  motorsThrustPerMotorMax=0.3266422)

EnvironmentBus = Simulink.Bus()
  Gravity_ned: double[3 1]
  AtmosphereBus: Bus: AtmosphereBus
  MagneticField_ned: double[3 1]

Vehicle = struct(
  SixDOF=struct(initGreenwich=0, quatGain=1),
  PositionOnEarth=struct(href=-71.3232, FlatEarthToLLA=struct(xAxis=0)),
  Airframe=struct(
    mass=0.063,
    inertia=[5.82857e-5 0 0; 0 7.16914e-5 0; 0 0 0.0001],
    d=0.0624,
    xy=0.04412346,
    h=-0.015876,
    Cdx=0,
    Cdy=0,
    diameter=0.01),
  Rotor=struct(
    blades=2,
    radius=0.033,
    chord=0.008,
    flappingOffset=0,
    bladeMass=0.000375,
    bladeInertia=1.020938e-07,
    hubMass=0,
    hubInertia=0,
    inertia=1.020938e-07,
    Ct=0.0107,
    Cq=0.0007826375,
    solidity=0.1543321,
    theta0=0.2548181,
    thetaTip=0.1186824,
    theta1=-0.1361357,
    theta34=0.1527163,
    a=5.5,
    area=0.003421194,
    lock=0.605147136,
    b=4.71999e-08,
    k=1.139284e-10,
    w2ToThrustGain=4.71999e-08),
  Motor=struct(maxLimit=500, minLimit=10, commandToW2Gain=13840.8, thrustToMotorCommand=1530.727))

DroneMass = 0.1
Dz = 2.5
Gravity = 9.81
Iz = 0
Nz = 14.49471
Pz = 6.8
oaMission = [struct(mode=uint8(1), position=single([-185.821884; -104.910637; -15]), params=single([15; 0; 0; 0])), struct(mode=uint8(4), position=single([114.943123; -0.752934635; -0]), params=single([0; 0; 0; 0])), struct(mode=uint8(3), position=single([-118.796204; -76.9053; -15]), params=single([2; 0; 12; 0])), struct(mode=uint8(4), position=single([-119.122398; -11.9655; -0]), params=single([0; 0; 0; 0])), struct(mode=uint8(2), position=single([-66.5216; 5.4292; -15]), params=single([-1.57079637; 0; 0; 0])), struct(mode=uint8(2), position=single([-35.1881; 7.2972; -15]), params=single([0; 0; 0; 0])), struct(mode=uint8(2), position=single([56.8487; 2.5424; -15]), params=single([0; 0; 0; 0])), struct(mode=uint8(2), position=single([170; 31; -15]), params=single([0; 0; 0; 0])), struct(mode=uint8(2), position=single([170.065506; 31.0655; -15]), params=single([0; 0; 0; 0])), struct(mode=uint8(2), position=single([170.043793; 31.0438; -15]), params=single([0; 0; 0; 0])), struct(mode=uint8(2), position=single([170.099792; 31.0998; -15]), params=single([0; 0; 0; 0])), struct(mode=uint8(2), position=single([170.096893; 31.0969; -15]), params=single([0; 0; 0; 0])), struct(mode=uint8(2), position=single([170.027; 31.027; -15]), params=single([0; 0; 0; 0])), struct(mode=uint8(2), position=single([170.095703; 31.0957; -15]), params=single([0; 0; 0; 0])), struct(mode=uint8(2), position=single([170.063705; 31.0637; -15]), params=single([0; 0; 0; 0])), struct(mode=uint8(2), position=single([170.019196; 31.0192; -15]), params=single([0; 0; 0; 0])), struct(mode=uint8(2), position=single([170.014099; 31.0141; -15]), params=single([0; 0; 0; 0])), struct(mode=uint8(2), position=single([170.0224; 31.0224; -15]), params=single([0; 0; 0; 0])), struct(mode=uint8(2), position=single([170.054; 31.054; -15]), params=single([0; 0; 0; 0])), struct(mode=uint8(2), position=single([170.014206; 31.0142; -15]), params=single([0; 0; 0; 0])), struct(mode=uint8(2), position=single([170.028107; 31.0281; -15]), params=single([0; 0; 0; 0])), struct(mode=uint8(2), position=single([170.063202; 31.0632; -15]), params=single([0; 0; 0; 0])), struct(mode=uint8(2), position=single([170.071198; 31.0712; -15]), params=single([0; 0; 0; 0])), struct(mode=uint8(2), position=single([170.050201; 31.0502; -15]), params=single([0; 0; 0; 0])), struct(mode=uint8(2), position=single([170.022202; 31.0222; -15]), params=single([0; 0; 0; 0])), struct(mode=uint8(2), position=single([170.081604; 31.0816; -15]), params=single([0; 0; 0; 0])), struct(mode=uint8(2), position=single([170.0634; 31.0634; -15]), params=single([0; 0; 0; 0])), struct(mode=uint8(2), position=single([170.093399; 31.0934; -15]), params=single([0; 0; 0; 0])), struct(mode=uint8(2), position=single([170.005402; 31.0054; -15]), params=single([0; 0; 0; 0])), struct(mode=uint8(2), position=single([170.046906; 31.0469; -15]), params=single([0; 0; 0; 0])), struct(mode=uint8(2), position=single([170.016693; 31.0167; -15]), params=single([0; 0; 0; 0])), struct(mode=uint8(2), position=single([170.026199; 31.0262; -15]), params=single([0; 0; 0; 0])), struct(mode=uint8(2), position=single([170.076202; 31.0762; -15]), params=single([0; 0; 0; 0])), struct(mode=uint8(2), position=single([170.027; 31.027; -15]), params=single([0; 0; 0; 0])), struct(mode=uint8(2), position=single([170.089294; 31.0893; -15]), params=single([0; 0; 0; 0])), struct(mode=uint8(2), position=single([170.065308; 31.0653; -15]), params=single([0; 0; 0; 0])), struct(mode=uint8(2), position=single([170.084503; 31.0845; -15]), params=single([0; 0; 0; 0])), struct(mode=uint8(2), position=single([170.063705; 31.0637; -15]), params=single([0; 0; 0; 0])), struct(mode=uint8(2), position=single([170.067703; 31.0677; -15]), params=single([0; 0; 0; 0])), struct(mode=uint8(2), position=single([170.032806; 31.0328; -15]), params=single([0; 0; 0; 0]))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]

BusPositionVelocity2 = Simulink.Bus()
  Position: single[2 34656]
  Velocity: double

wayPoints1 = {[-216.1833 -62.5807; -243.05 -63.28772; -243.05 -86.6193; -214.0623 -86.6193; -214.0623 -63.28772], [-211.9412 -106.4158; -214.0623 -105.0018; -242.343 -105.0018; -240.9289 -133.2825; -211.9412 -133.9895; -212.6482 -107.8298], [-180.8325 -58.3386
 -180.8325 -58.3386
 -188.6096 -59.75263
 -187.9026 -83.79123
 -156.0868 -83.79123
 -156.7939 -57.63158
 -124.9781 -56.92456
 -124.9781 -34.3
 -179.4184 -34.3
 -178.7114 -59.04561
 -178.7114 -59.04561], [-172.3482 -109.2439
 -188.6096 -109.2439
 -188.6096 -135.4035
 -123.564 -135.4035
 -123.564 -107.8298
 -160.3289 -107.8298
 -160.3289 -114.193
 -172.3482 -115.607
 -172.3482 -110.6579], [-100.9395 0.3438596; -99.52544 -47.73333; -78.31491 -48.44035; -77.60789 -22.98772; -33.77281 -22.98772; -33.77281 1.050877; -100.9395 1.050877], [-75.48684 -51.97544; -74.77982 -87.32632; -32.35877 -85.91228; -33.06579 -49.85439; -74.07281 -50.5614], [-95.99035 -108.5368
 -95.28333 -117.0211
 -88.92018 -117.0211
 -89.62719 -129.0404
 -96.69737 -129.0404
 -96.69737 -136.1105
 -36.60088 -134.6965
 -36.60088 -108.5368
 -52.86228 -108.5368
 -52.86228 -114.193
 -63.46754 -113.486
 -62.76053 -108.5368
 -95.28333 -108.5368], [-10.44123 2.464912; -10.44123 2.464912; -9.734211 -34.3; 5.113158 -33.59298; 5.113158 3.17193; -10.44123 3.17193], [-12.56228 -49.85439; -11.85526 -88.03333; 3.699123 -88.03333; 3.699123 -49.14737; -11.85526 -49.14737], [-6.90614 61.85439; -5.492105 23.67544; 19.25351 23.67544; 19.25351 58.3193; -6.199123 59.02632], [-61.34649 59.73333; -62.05351 22.96842; -33.77281 22.96842; -33.77281 59.73333; -63.46754 59.73333; -63.46754 59.73333]}

baseMission = [struct(mode=uint8(1), position=single([-185.821884; -104.910637; -15]), params=single([15; 0; 0; 0])), struct(mode=uint8(4), position=single([114.943123; -0.752934635; -0]), params=single([0; 0; 0; 0])), struct(mode=uint8(3), position=single([-118.796204; -76.9053; -15]), params=single([2; 0; 12; 0])), struct(mode=uint8(4), position=single([-119.122398; -11.9655; -0]), params=single([0; 0; 0; 0])), struct(mode=uint8(2), position=single([-66.5216; 5.4292; -15]), params=single([-1.57079637; 0; 0; 0])), struct(mode=uint8(2), position=single([-35.1881; 7.2972; -15]), params=single([0; 0; 0; 0])), struct(mode=uint8(2), position=single([56.8487; 2.5424; -15]), params=single([0; 0; 0; 0])), struct(mode=uint8(2), position=single([170; 31; -15]), params=single([0; 0; 0; 0])), struct(mode=uint8(2), position=single([170.065506; 31.0655; -15]), params=single([0; 0; 0; 0])), struct(mode=uint8(2), position=single([170.043793; 31.0438; -15]), params=single([0; 0; 0; 0])), struct(mode=uint8(2), position=single([170.099792; 31.0998; -15]), params=single([0; 0; 0; 0])), struct(mode=uint8(2), position=single([170.096893; 31.0969; -15]), params=single([0; 0; 0; 0])), struct(mode=uint8(2), position=single([170.027; 31.027; -15]), params=single([0; 0; 0; 0])), struct(mode=uint8(2), position=single([170.095703; 31.0957; -15]), params=single([0; 0; 0; 0])), struct(mode=uint8(2), position=single([170.063705; 31.0637; -15]), params=single([0; 0; 0; 0])), struct(mode=uint8(2), position=single([170.019196; 31.0192; -15]), params=single([0; 0; 0; 0])), struct(mode=uint8(2), position=single([170.014099; 31.0141; -15]), params=single([0; 0; 0; 0])), struct(mode=uint8(2), position=single([170.0224; 31.0224; -15]), params=single([0; 0; 0; 0])), struct(mode=uint8(2), position=single([170.054; 31.054; -15]), params=single([0; 0; 0; 0])), struct(mode=uint8(2), position=single([170.014206; 31.0142; -15]), params=single([0; 0; 0; 0])), struct(mode=uint8(2), position=single([170.028107; 31.0281; -15]), params=single([0; 0; 0; 0])), struct(mode=uint8(2), position=single([170.063202; 31.0632; -15]), params=single([0; 0; 0; 0])), struct(mode=uint8(2), position=single([170.071198; 31.0712; -15]), params=single([0; 0; 0; 0])), struct(mode=uint8(2), position=single([170.050201; 31.0502; -15]), params=single([0; 0; 0; 0])), struct(mode=uint8(2), position=single([170.022202; 31.0222; -15]), params=single([0; 0; 0; 0])), struct(mode=uint8(2), position=single([170.081604; 31.0816; -15]), params=single([0; 0; 0; 0])), struct(mode=uint8(2), position=single([170.0634; 31.0634; -15]), params=single([0; 0; 0; 0])), struct(mode=uint8(2), position=single([170.093399; 31.0934; -15]), params=single([0; 0; 0; 0])), struct(mode=uint8(2), position=single([170.005402; 31.0054; -15]), params=single([0; 0; 0; 0])), struct(mode=uint8(2), position=single([170.046906; 31.0469; -15]), params=single([0; 0; 0; 0])), struct(mode=uint8(2), position=single([170.016693; 31.0167; -15]), params=single([0; 0; 0; 0])), struct(mode=uint8(2), position=single([170.026199; 31.0262; -15]), params=single([0; 0; 0; 0])), struct(mode=uint8(2), position=single([170.076202; 31.0762; -15]), params=single([0; 0; 0; 0])), struct(mode=uint8(2), position=single([170.027; 31.027; -15]), params=single([0; 0; 0; 0])), struct(mode=uint8(2), position=single([170.089294; 31.0893; -15]), params=single([0; 0; 0; 0])), struct(mode=uint8(2), position=single([170.065308; 31.0653; -15]), params=single([0; 0; 0; 0])), struct(mode=uint8(2), position=single([170.084503; 31.0845; -15]), params=single([0; 0; 0; 0])), struct(mode=uint8(2), position=single([170.063705; 31.0637; -15]), params=single([0; 0; 0; 0])), struct(mode=uint8(2), position=single([170.067703; 31.0677; -15]), params=single([0; 0; 0; 0])), struct(mode=uint8(2), position=single([170.032806; 31.0328; -15]), params=single([0; 0; 0; 0]))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]
initialConditions = struct(date=[2017 1 1 0 0 0], posLLA=[0 0 0], posNED=[0 0 0], vb=[0 0 0], euler=[0 0 0], angRates=[0 0 0])
uavIC_latLon = [0 0]
Sig = Simulink.Signal()
Sig1 = Simulink.Signal()
Sig2 = Simulink.Signal()
Sig3 = Simulink.Signal()
Sig4 = Simulink.Signal()
Sig5 = Simulink.Signal()
crackMission = [struct(mode=1, position=[-105; -3; -15], params=[0; 0; 0; 0]), struct(mode=4, position=[20; -3; 0], params=[0; 0; 0; 0]), struct(mode=2, position=[-80; -3; -15], params=[0; 0; 0; 0]), struct(mode=2, position=[-70; -3; -15], params=[0; 0; 0; 0])]